# Dynamo graph LegendOnSheets.dyn (Dynamo 2.6.1.8786)
# packages: Rhythm 2020.9.8

sheetNumber = Sheet.SheetNumber()  # unwired: sheet
categories = Categories("OST_Sheets")
all_elements_of_category = ElementsOfCategory(Category=categories)
sheetNumber_2 = Sheet.SheetNumber(sheet=all_elements_of_category)
string = StringInput("A")
contains = String.Contains(str=sheetNumber_2, searchFor=string)
filterByBoolMask = List.FilterByBoolMask(list=all_elements_of_category, mask=contains)
watch = Watch(filterByBoolMask.in)
watch_2 = Watch(sheetNumber_2)
firstIndexOf = List.FirstIndexOf()  # unwired: list, item
categories_2 = Categories("OST_Views")
all_elements_of_category_2 = ElementsOfCategory(Category=categories_2)
isNull = Object.IsNull(obj=all_elements_of_category_2)
filterByBoolMask_2 = List.FilterByBoolMask(list=all_elements_of_category_2, mask=isNull)
name = Element.Name(element=filterByBoolMask_2.out)
legend_name_string = StringInput("Door Legend")
firstIndexOf_2 = List.FirstIndexOf(list=name, item=legend_name_string)
getItemAtIndex = List.GetItemAtIndex(list=filterByBoolMask_2.out, index=firstIndexOf_2)
number = DoubleInput(200)
number_2 = DoubleInput(300)
number_3 = DoubleInput(0)
byCoordinates = Point.ByCoordinates(x=number, y=number_2, z=number_3)
ʳʰʸᵗʰᵐ_viewport_create = Rhythm.Revit.Elements.Viewport.Create(sheet=filterByBoolMask.in, view=getItemAtIndex, location=byCoordinates)
