# Dynamo graph LevelsFromExcel.dyn (Dynamo 2.6.1.8786)

file_path = Filename(".\Levels.xlsx")
file_from_path = FileObject(path=file_path)
string = StringInput("Sheet1")
boolean = BoolSelector(true)
boolean_2 = BoolSelector(true)
importExcel = Data.ImportExcel(file=file_from_path, sheetName=string, readAsStrings=boolean, showExcel=boolean_2)
watch = Watch(importExcel)
code_block = CodeBlock { 0; }
getItemAtIndex = List.GetItemAtIndex(list=watch, index=code_block)
code_block_2 = CodeBlock { 1; }
getItemAtIndex_2 = List.GetItemAtIndex(list=getItemAtIndex, index=code_block_2)
watch_2 = Watch(getItemAtIndex_2)
toNumber = String.ToNumber(str=watch_2)
getItemAtIndex_3 = List.GetItemAtIndex(list=watch, index=code_block)
code_block_3 = CodeBlock { 0; }
getItemAtIndex_4 = List.GetItemAtIndex(list=getItemAtIndex_3, index=code_block_3)
watch_3 = Watch(getItemAtIndex_4)
byElevationAndName = Level.ByElevationAndName(elevation=toNumber, name=watch_3)
