# Dynamo graph PipeFromPLine.dyn (Dynamo 2.6.1.8786)
# packages: MEPover 2020.6.2

element_types = ElementTypes("PipeType")
all_elements_of_type = ElementsOfType(element_type=element_types)
name = Element.Name(element=all_elements_of_type)
watch = Watch(name)
element_types_2 = ElementTypes("CurveElement")
all_elements_of_type_2 = ElementsOfType(element_type=element_types_2)
name_2 = Element.Name(element=all_elements_of_type_2)
string = StringInput("Model Lines")
eq = name_2 == string
filterByBoolMask = List.FilterByBoolMask(list=all_elements_of_type_2, mask=eq)
string_2 = StringInput("Line Style")
getParameterValueByName = Element.GetParameterValueByName(element=filterByBoolMask.in, parameterName=string_2)
name_3 = Element.Name(element=getParameterValueByName)
toNumber = String.ToNumber(str=name_3)
string_3 = StringInput("0\n")
toNumber_2 = String.ToNumber(str=string_3)
eq_2 = Equals(x=toNumber, y=toNumber_2)
filterByBoolMask_2 = List.FilterByBoolMask(list=filterByBoolMask.in, mask=eq_2)
watch_2 = Watch(filterByBoolMask_2.in)
curve = CurveElement.Curve(curveElement=watch_2)
string_4 = StringInput("ABS - Solvent Welded")
firstIndexOf = List.FirstIndexOf(list=name, item=string_4)
getItemAtIndex = List.GetItemAtIndex(list=all_elements_of_type, index=firstIndexOf)
element_types_3 = ElementTypes("MEPSystemType")
all_elements_of_type_3 = ElementsOfType(element_type=element_types_3)
name_4 = Element.Name(element=all_elements_of_type_3)
string_5 = StringInput("Domestic Hot Water")
firstIndexOf_2 = List.FirstIndexOf(list=name_4, item=string_5)
getItemAtIndex_2 = List.GetItemAtIndex(list=all_elements_of_type_3, index=firstIndexOf_2)
levels = Levels("Level 1")
number = DoubleInput(200)
byLines = Custom[Pipe.ByLines](Lines=curve, PipeType=getItemAtIndex, SystemType=getItemAtIndex_2, level=levels, Diameter=number)  # package MEPover; Creates a pipe by Line, PipeType, SystemType, Level and Diameter
